# Grasshopper definition Type3_GH.gh (Grasshopper 1.0.8)
# plug-ins: Karamba3D, RhinoCodePluginGH

# ----
# Size of site (length)
# Numbers of space
# Initialize
# Display spaces layout
number_slider = Slider(20, range=0..100)
number_slider_2 = Slider(1.5, range=0..10)
multiplication = Multiplication(A=number_slider, B=number_slider_2)
construct_domain = ConstructDomain(DomainStart=0, DomainEnd=multiplication)
rectangle = Rectangle(Plane=PlaneXY(0, 0, 0), XSize=construct_domain, YSize=construct_domain, Radius=0)  # -> Rectangle, Length
trigger = Trigger(Interval=10, TimerInterval=10, Target=c_script)  # disabled
area = Area(Geometry=rectangle.Rectangle)  # -> Area, Centroid
explode = Explode(Curve=rectangle.Rectangle, Recursive=True)  # -> flatten(Segments), Vertices
c_script = CSharpScript(boundary=rectangle.Rectangle, numOfSpace=Slider(13, range=0..100), generate=Button())  # -> out, Cells, edgeLength, corners, EccentricityRate; inputs boundary: Curve, numOfSpace: Int32, generate: Boolean
# ---------- c_script: C# ----------
// Grasshopper Script Instance
#region Usings
using System;
using System.Linq;
using System.Collections;
using System.Collections.Generic;
using System.Drawing;

using Rhino;
using Rhino.Geometry;

using Grasshopper;
using Grasshopper.Kernel;
using Grasshopper.Kernel.Data;
using Grasshopper.Kernel.Types;
#endregion
using Grasshopper.Kernel.Geometry;

public class Script_Instance : GH_ScriptInstance
{
    #region Notes
    /* 
      Members:
        RhinoDoc RhinoDocument
        GH_Document GrasshopperDocument
        IGH_Component Component
        int Iteration

      Methods (Virtual & overridable):
        Print(string text)
        Print(string format, params object[] args)
        Reflect(object obj)
        Reflect(object obj, string method_name)
    */
    #endregion

    private void RunScript(
	Curve boundary,
	int numOfSpace,
	bool generate,
	ref object Cells,
	ref object edgeLength,
	ref object corners,
	ref object EccentricityRate)
    {
        BoundingBox bx = boundary.GetBoundingBox(true);
        Line[] edges = bx.GetEdges();
        Point3d[] bxCorners = bx.GetCorners();
        List<Point3d> cornerPts = new List<Point3d>();
        foreach(Point3d p in bxCorners)
        {
            cornerPts.Add(p);
        }

        Node2List nodes = new Node2List();
        Node2List outline = new Node2List();

        //vornoi algorithm
        if (generate || redo)
        {
            cellPts.Clear();
            lengthEdges.Clear();
            polys.Clear();
            generate = false;
            redo = false;

            for(int i = 0; i < edges.Length; i++)
            {
                if (edges[i] != null)
                {
                    lengthEdges.Add(edges[i].Length);
                }
            }
            lengthEdges.Sort();
            lengthEdges.Reverse();

            GetVoronoi(numOfSpace, boundary, nodes, bxCorners, outline);

        }
        geoCenter = new Point3d(0, 0, 0);
        foreach (Point3d p in cornerPts)
        {
            geoCenter += p;
        }
        geoCenter /= cornerPts.Count;
        averageCenter = new Point3d(0, 0, 0);
        foreach (Point3d p in cellPts)
        {
            averageCenter += p;
        }
        averageCenter /= cellPts.Count;
        eccentricity = geoCenter.DistanceTo(averageCenter) / lengthEdges[0];
        if(eccentricity > 0.05)
        {
            redo = true;
        }

        Cells = polys;
        edgeLength = lengthEdges[0];
        corners = cornerPts;
        EccentricityRate = eccentricity;
    }

    public static List<Point3d> cellPts = new List<Point3d>();
    public static Random rdn = new Random();

    public static List<double> lengthEdges = new List<double>();
    public static List<Polyline> polys = new List<Polyline>();


    public static Point3d geoCenter;
    public static Point3d averageCenter;
    public static double eccentricity;
    public static bool redo = false;

    public static void GetVoronoi(int count, Curve boundary, Node2List nodes, Point3d[] bxCorners, Node2List outline)
    {
        cellPts.Clear();
        polys.Clear();
        //create random points
        for (int i = 0; i < count; i++)
        {
            double x = rdn.NextDouble();
            double y = rdn.NextDouble();
            Point3d pt = new Point3d(x * lengthEdges[0], y * lengthEdges[0], 0);
            //check if point is inside the boundary
            if (boundary.Contains(pt, Rhino.Geometry.Plane.WorldXY, 0.001) == PointContainment.Inside)
            {
                cellPts.Add(pt);
            }
            else
            {
                i--;
            }
            }

        //referenced from >>https://www.grasshopper3d.com/forum/topics/feature-request-access-to-grasshopper-scripts-in-python-c?commentId=2985220%3AComment%3A678528
        //Script from Anders Holden Deleuran
        //Tranformed in C# by Laurent Delrieu
        foreach (Point3d p in cellPts)
        {
            Node2 n = new Node2(p.X, p.Y);
            nodes.Append(n);
        }

        foreach (Point3d p in bxCorners)
        {
            Node2 n = new Node2(p.X, p.Y);
            outline.Append(n);
        }
        //Calculate the delaunay triangulation
        var delaunay = Grasshopper.Kernel.Geometry.Delaunay.Solver.Solve_Connectivity(nodes, 0.1, false);

        //Calculate the voronoi diagram
        var voronoi = Grasshopper.Kernel.Geometry.Voronoi.Solver.Solve_Connectivity(nodes, delaunay, outline);

        foreach (var c in voronoi)
        {
            Polyline pl = c.ToPolyline();
            Brep bp = Brep.CreatePlanarBreps(pl.ToNurbsCurve(), 0.01)[0];
            if (bp.GetArea() > lengthEdges[0] * lengthEdges[1] / count * 0.5 && bp.GetArea() < lengthEdges[0] * lengthEdges[1] / count * 1.5)
            {
                polys.Add(pl);
            }
            else
            {
                redo = true;
                break;
            }
        }
    }
}
# ---------- end c_script ----------
curve = Curve(explode.Segments)
cluster = Cluster(geometry_2=c_script.Cells, geometry=c_script.Cells)
nurbs_curve = NurbsCurve(Vertices=cluster, Degree=3, Periodic=True)  # -> Curve, Length, Domain
# Sketch Model Process
colour_swatch = ColourSwatch(SwatchColor=RGBA(0, 0, 0, 96))
cluster_2 = Cluster_2(curve=c_script.Cells)
curve_2 = Curve(cluster_2)
custom_preview = CustomPreview(Geometry=[nurbs_curve.Curve, curve, curve_2], Material=colour_swatch)
c_script_2 = CSharpScript(
    lns=curve_2,
    edgeRange=c_script.edgeLength,
    borders=explode.Segments,
    moduleSize=number_slider_2,
    maxDist=Slider(1.5, range=0..10),
    density=Slider(0.15, range=0..1),
    ceilingHeight=Slider(6, range=0..10),
    numOfTreetopLayers=Slider(7, range=0..10),
    corners=c_script.corners,
    siteArea=area.Area,
    reset=Button())  # -> out, basePts, upperPts, a; inputs lns: list of Line, edgeRange: Double, borders: list of Line, moduleSize: Double, maxDist: Double, density: Double, ceilingHeight: Double, numOfTreetopLayers: Int32, corners: list of Point3d, siteArea: Double, reset: Boolean
# ---------- c_script_2: C# ----------
// Grasshopper Script Instance
#region Usings
using System;
using System.Linq;
using System.Collections;
using System.Collections.Generic;
using System.Drawing;

using Rhino;
using Rhino.Geometry;

using Grasshopper;
using Grasshopper.Kernel;
using Grasshopper.Kernel.Data;
using Grasshopper.Kernel.Types;
#endregion
using Grasshopper.Kernel.Geometry;
using System.IO;
public class Script_Instance : GH_ScriptInstance
{
    #region Notes
    /* 
      Members:
        RhinoDoc RhinoDocument
        GH_Document GrasshopperDocument
        IGH_Component Component
        int Iteration

      Methods (Virtual & overridable):
        Print(string text)
        Print(string format, params object[] args)
        Reflect(object obj)
        Reflect(object obj, string method_name)
    */
    #endregion

    private void RunScript(
	List<Line> lns,
	double edgeRange,
	List<Line> borders,
	double moduleSize,
	double maxDist,
	double density,
	double ceilingHeight,
	int numOfTreetopLayers,
	List<Point3d> corners,
	double siteArea,
	bool reset,
	ref object basePts,
	ref object upperPts,
	ref object a)
    {
        if(reset){
            moduleSize_ = moduleSize;
            possibleColumnsNum = 0;
            testColumnsNum = 0;
            possibleBranchesNum = 0;
            testBranchesNum = 0;

            reset = false;
            //generate gird
            GenerateGrids(edgeRange);
            CheckAllowabilityGrids(lns, borders, maxDist);

            
            for (int i = 0; i < grids.GetLength(0); i++)
            {
                for (int j = 0; j < grids.GetLength(1); j++)
                {
                    if (grids[i, j].allowability == 1)
                    {
                        possibleColumnsNum++;
                    }
                }
            }

            // create first level start points
            testColumnsNum = (int) (density * possibleColumnsNum);
            GenerateCols(testColumnsNum, grids);

            // create tree top level
            GenerateTGrids(edgeRange, numOfTreetopLayers, ceilingHeight);
            for (int i = 0; i < tGrids.GetLength(0); i++)
            {
                for (int j = 0; j < tGrids.GetLength(1); j++)
                {
                    for (int k = 0; k < tGrids.GetLength(2); k++){
                        if (tGrids[i, j, k].allowability == 1)
                        {
                            possibleBranchesNum++;
                        }                        
                    }

                }
            }
            // create branches points
            testBranchesNum = (int) (density * possibleBranchesNum);
            GenerateBranches(testBranchesNum,tGrids,ceilingHeight);
        }
        basePts = startPtsList;
        upperPts = branchesPtsList;
        
        
    }

    private static Random rnd = new Random();
    public static Grid[,] grids;
    public static Grid[,,] tGrids;
    public static double moduleSize_;

    public static int possibleColumnsNum;
    public static int testColumnsNum;

    public static List<Point3d> startPtsList = new List<Point3d>();
    public static List<int> testOccup = new List<int>();

    public static int possibleBranchesNum;
    public static int testBranchesNum;

    public static List<Point3d> branchesPtsList = new List<Point3d>();
    public static List<int> testBranchesOccup = new List<int>();


    public void GenerateGrids(double edgeRange)
    {
        grids = new Grid[(int) (edgeRange / moduleSize_), (int) (edgeRange / moduleSize_)];
        for (int i = 0; i < (edgeRange / moduleSize_); i++)
        {
            for (int j = 0; j < (edgeRange / moduleSize_); j++)
            {
                grids[i, j] = new Grid(0);
                grids[i, j].centerPt = new Point3d((i + 0.5) * moduleSize_, (j + 0.5) * moduleSize_, 0);
                grids[i, j].onEdge = 0;
            }
        }
    }

    public void GenerateTGrids(double edgeRange, int layers, double height)
    {
        tGrids = new Grid[(int) (edgeRange / moduleSize_), (int) (edgeRange / moduleSize_), layers];
        for (int i = 0; i < (edgeRange / moduleSize_); i++)
        {
            for (int j = 0; j < (edgeRange / moduleSize_); j++)
            {
                for(int k = 1; k < layers+1; k++){
                    tGrids[i, j, k-1] = new Grid(0);
                    tGrids[i, j, k-1].centerPt = new Point3d((i + 0.5) * moduleSize_, (j + 0.5) * moduleSize_, k * moduleSize_ + height);
                    tGrids[i, j, k-1].onEdge = 0;
                    tGrids[i, j, k-1].allowability = 1;
                }

            }
        }
    }

    public void CheckAllowabilityGrids(List<Line> lns, List<Line> borders, double maxDist)
    {
        for (int i = 0; i < grids.GetLength(0); i++)
        {
            for (int j = 0; j < grids.GetLength(1); j++)
            {
                Point3d pt = grids[i, j].centerPt;
                //distance to the closest line
                List<double> dists = new List<double>();
                for (int k = 0; k < lns.Count; k++)
                {
                    dists.Add(pt.DistanceTo(lns[k].ClosestPoint(pt, true)));
                }
                dists.Sort();
                //distance to the borders
                List<double> dists2 = new List<double>();
                for (int k = 0; k < borders.Count; k++)
                {
                    dists2.Add(pt.DistanceTo(borders[k].ClosestPoint(pt, true)));
                }
                dists2.Sort();
                if (dists[0] < maxDist && dists2[0] > 0.5 * maxDist)
                {
                    grids[i, j].allowability = 1;
                }
                else
                {
                    grids[i, j].allowability = 0;
                }
            }
        }
    }

    public void GenerateCols(int testColumnsNum, Grid[,] grids)
    {
        startPtsList.Clear();

        int allowGridsNum = 0;
        for (int i = 0; i < grids.GetLength(0); i++)
        {
            for (int j = 0; j < grids.GetLength(1); j++)
            {
                if (grids[i, j].allowability == 1)
                {
                    allowGridsNum++;
                }
            }
        }

        List<int> occupiedGrids = new List<int>();
        for (int i = 0; i < testColumnsNum; i++)
        {
            occupiedGrids.Add(1);
        }
        for (int i = 0; i < allowGridsNum - testColumnsNum; i++)
        {
            occupiedGrids.Add(0);
        }
        var shuffle_occupiedGrids = occupiedGrids.OrderBy(o => rnd.Next()).ToList();
            testOccup = shuffle_occupiedGrids;

        var a = 0;

        //asssign the occupied grids
        for (int i = 0; i < grids.GetLength(0); i++)
        {
            for (int j = 0; j < grids.GetLength(1); j++)
            {
                if (grids[i, j].allowability == 1)
                {
                    grids[i, j].occupied = shuffle_occupiedGrids[a];
                    a++;
                }       
                else
                {
                    grids[i, j].occupied = 0;
                }
            }
        }

        //create a list of points
        for (int i = 0; i < grids.GetLength(0); i++)
        {
            for (int j = 0; j < grids.GetLength(1); j++)
            {
                if (grids[i, j].occupied == 1)
                {
                    var x = rnd.NextDouble();
                    var y = rnd.NextDouble();
                    if (x < 0.2)
                    {
                        x = 0;
                        grids[i, j].onEdge = 1;
                    }
                    else if (x > 0.8)
                    {
                        x = 1;
                        grids[i, j].onEdge = 1;
                    }
                    if (y < 0.2)
                    {
                        y = 0;
                        grids[i, j].onEdge = 1;
                    }
                    else if (y > 0.8)
                    {
                        y = 1;
                        grids[i, j].onEdge = 1;
                    }

                    Point3d pt = new Point3d((i + x) * moduleSize_, (j + y) * moduleSize_, 0);
                    grids[i, j].innerPt = pt;
                    startPtsList.Add(pt);
                    
                }
            }
        }
    }

    
    public void GenerateBranches(int testBranchesNum, Grid[,,] tGrids, double height)
    {
        branchesPtsList.Clear();

        int allowGridsNum = 0;
        for (int i = 0; i < tGrids.GetLength(0); i++)
        {
            for (int j = 0; j < tGrids.GetLength(1); j++)
            {
                for (int k = 0; k < tGrids.GetLength(2); k++){
                    if (tGrids[i, j, k].allowability == 1)
                    {
                        allowGridsNum++;
                    } 
                }
            }
        }
        

        List<int> occupiedGrids = new List<int>();
        for (int i = 0; i < testBranchesNum; i++)
        {
            occupiedGrids.Add(1);
        }
        for (int i = 0; i < allowGridsNum - testBranchesNum; i++)
        {
            occupiedGrids.Add(0);
        }
        var shuffle_occupiedGrids = occupiedGrids.OrderBy(o => rnd.Next()).ToList();
            testBranchesOccup = shuffle_occupiedGrids;

        var a = 0;

        //asssign the occupied grids
        
        for (int i = 0; i < tGrids.GetLength(0); i++)
        {
            for (int j = 0; j < tGrids.GetLength(1); j++)
            {
                for (int k = 0; k < tGrids.GetLength(2); k++){
                    if (tGrids[i, j, k].allowability == 1)
                    {
                        tGrids[i, j, k].occupied = shuffle_occupiedGrids[a];
                        a++;
                    }       
                    else
                    {
                        tGrids[i, j, k].occupied = 0;
                    }
                }

            }
        }

        //create a list of points
        for (int i = 0; i < tGrids.GetLength(0); i++)
        {
            for (int j = 0; j < tGrids.GetLength(1); j++)
            {
                for (int k = 0; k < tGrids.GetLength(2); k++){
                    if (tGrids[i, j, k].occupied == 1)
                    {
                        var x = rnd.NextDouble();
                        var y = rnd.NextDouble();
                        var z = rnd.NextDouble();
                        if (x < 0.2)
                        {
                            x = 0;
                            tGrids[i, j, k].onEdge = 1;
                        }
                        else if (x > 0.8)
                        {
                            x = 1;
                            tGrids[i, j, k].onEdge = 1;
                        }
                        if (y < 0.2)
                        {
                            y = 0;
                            tGrids[i, j, k].onEdge = 1;
                        }
                        else if (y > 0.8)
                        {
                            y = 1;
                            tGrids[i, j, k].onEdge = 1;
                        }

                        Point3d pt = new Point3d((i + x) * moduleSize_, (j + y) * moduleSize_, (k + z)* moduleSize_+height);
                        tGrids[i, j, k].innerPt = pt;
                        branchesPtsList.Add(pt);
                    
                    }
                }

            }
        }
        
    }
    
}

public class Grid
{
    public int occupied; //0 = empty, 1 = occupied
    public Point3d innerPt;
    public Point3d centerPt;
    public int allowability; //0 = not allowed, 1 = allowed
    public int onEdge; //0 = not on edge, 1 = on edge
    public Grid(int occupied)
    {
      this.occupied = occupied;
    }
}
# ---------- end c_script_2 ----------
point = Point(c_script_2.upperPts)
point_2 = Point(c_script_2.basePts)
c_script_3 = CSharpScript(basePts=point_2, upperPts=point, iteration=Slider(3, range=0..4))  # -> out, branchesList, supportsList, c; inputs basePts: list of Point3d, upperPts: list of Point3d, iteration: Int32
# ---------- c_script_3: C# ----------
// Grasshopper Script Instance
#region Usings
using System;
using System.Linq;
using System.Collections;
using System.Collections.Generic;
using System.Drawing;

using Rhino;
using Rhino.Geometry;

using Grasshopper;
using Grasshopper.Kernel;
using Grasshopper.Kernel.Data;
using Grasshopper.Kernel.Types;
#endregion

public class Script_Instance : GH_ScriptInstance
{
    #region Notes
    /* 
      Members:
        RhinoDoc RhinoDocument
        GH_Document GrasshopperDocument
        IGH_Component Component
        int Iteration

      Methods (Virtual & overridable):
        Print(string text)
        Print(string format, params object[] args)
        Reflect(object obj)
        Reflect(object obj, string method_name)
    */
    #endregion

    private void RunScript(
	List<Point3d> basePts,
	List<Point3d> upperPts,
	int iteration,
	ref object branchesList,
	ref object supportsList,
	ref object c)
    {
        closetPts.Clear();
        branches.Clear();
        branchPts.Clear();

        int step = iteration;
        List<Point3d> supports = new List<Point3d>();

        foreach (var pt in upperPts)
        {
            BranchPt bPt = new BranchPt(pt,0,0);
            branchPts.Add(bPt);
        }

        // first branch
        foreach (var pt in basePts)
        {
            var cp = findClosetPt(pt,branchPts);
            closetPts.Add(cp);
        }

        for(int i = 0; i<basePts.Count;i++){
            if(closetPts[i]!= new Point3d(0,0,0)){
                Line branch = new Line(basePts[i],closetPts[i]);
                branches.Add(branch);
                supports.Add(basePts[i]);
            }
            
        }
        List<Point3d> stPts = new List<Point3d>();
        List<Line> checkBranches = new List<Line>();
        foreach (var bPt in branchPts)
        {
            if(bPt.startBranch==1){
                stPts.Add(bPt.pt);
            }
        }

        
        for(int i = 0; i< step; i++){
            List<Point3d> temp = new List<Point3d>();
            //List<Line> tempLines = new List<Line>();
            
            foreach (var stPt in stPts)
            {
                var cps = findClosetThreePts(stPt,branchPts);
                for(int j = 0; j<cps.Length;j++){
                    double dist = stPt.DistanceTo(cps[j]);
                    if(dist<Math.Pow(0.9,i)*6 && cps[j]!= new Point3d(0,0,0)){
                        temp.Add(cps[j]);
                        Line branch = new Line(stPt,cps[j]);
                        //if(checkBranches.Find(line => line.Equals(branch))!=null){
                            //Line flipBranch = new Line(cps[j],stPt);
                            branches.Add(branch);
                            //tempLines.Add(flipBranch);
                        //}
                        
                    }
                    
                }
                for(int k = 0; k<branchPts.Count;k++)
                {
                    if(branchPts[k].used>6){
                        BranchPt removePt = branchPts[k];
                        branchPts.Remove(removePt);
                    }
                }
                

                
            }
            
            stPts = temp;
            //checkBranches = tempLines;
        }
        

        branchesList = branches;
        supportsList = supports;
        //c = branchPts;
    }

    List<BranchPt> branchPts = new List<BranchPt>();

    List<Point3d> closetPts = new List<Point3d>();
    List<Point3d> usedPts = new List<Point3d>();
    List<Line> branches = new List<Line>();


    public static Point3d findClosetPt(Point3d a, List<BranchPt> bPts){
        List<double> dists = new List<double>();
        Point3d cp;
        foreach (var bPt in bPts)
        {
            double dist = bPt.pt.DistanceTo(a);
            dists.Add(dist);
        }
        List<double> sorted_dists = new List<double>(dists);
        sorted_dists.Sort();
        int n = 0;
        var cpIndex = dists.FindIndex(x => x==sorted_dists[0]);
        if(bPts[cpIndex].startBranch==0){
            cp = bPts[cpIndex].pt;
            bPts[cpIndex].startBranch = 1;
            bPts[cpIndex].used = 5;
            return cp;
        }else{
            return new Point3d(0,0,0);
        }
        
        
    }

    public static Point3d[] findClosetThreePts(Point3d a, List<BranchPt> bPts){
        List<double> dists = new List<double>();
        foreach (var bPt in bPts)
        {
            double dist = bPt.pt.DistanceTo(a);
            dists.Add(dist);
        }
        List<double> sorted_dists = new List<double>(dists);
        sorted_dists.Sort();
        if (sorted_dists.Count==1)
        {
            Point3d[] cps = {new Point3d(0,0,0)};
            return cps;
        }else if(sorted_dists.Count==2){
            var cpIndex0 = dists.FindIndex(x => x==sorted_dists[1]);
            Point3d cp0 = bPts[cpIndex0].pt;
            bPts[cpIndex0].used++;
            Point3d[] cps = {cp0};
            return cps;
        }else if(sorted_dists.Count==3){
            var cpIndex0 = dists.FindIndex(x => x==sorted_dists[1]);
            var cpIndex1 = dists.FindIndex(x => x==sorted_dists[2]);
            Point3d cp0 = bPts[cpIndex0].pt;
            bPts[cpIndex0].used++;
            Point3d cp1 = bPts[cpIndex1].pt;
            bPts[cpIndex1].used++;
            Point3d[] cps = {cp0,cp1};
            return cps;
        }else{
            var cpIndex0 = dists.FindIndex(x => x==sorted_dists[1]);
            var cpIndex1 = dists.FindIndex(x => x==sorted_dists[2]);
            var cpIndex2 = dists.FindIndex(x => x==sorted_dists[3]);
            Point3d cp0 = bPts[cpIndex0].pt;
            bPts[cpIndex0].used++;
            Point3d cp1 = bPts[cpIndex1].pt;
            bPts[cpIndex1].used++;
            Point3d cp2 = bPts[cpIndex2].pt;
            bPts[cpIndex2].used++;
            Point3d[] cps = {cp0,cp1,cp2};
            return cps;
        }
    }
}

public class BranchPt{
    public Point3d pt;
    public int startBranch; // 0, 1
    public int used; // 0, 1, 2, 3, 4, 5

    public BranchPt(Point3d pt, int startBranch, int used){
        this.pt = pt;
        this.startBranch = startBranch;
        this.used = used;
    }
}
# ---------- end c_script_3 ----------

cluster_3 = Cluster_3(curves=c_script_3.branchesList)
point_3 = Point(c_script_3.supportsList)

material_selection_karamba3d = MatSelect(menu=[dropdown(2), dropdown(1)])
number_slider_3 = Slider(15, range=0..100)
cross_section_karamba3d = CroSec(
    FamilyNameOfCrossSection="DefaultCroSec",
    Material=material_selection_karamba3d,
    Height_cm=Slider(15, range=0..100),
    UpperFlangeWidth_cm=number_slider_3,
    LowerFlangeWidth_cm=number_slider_3,
    mode="Trapezoid")
curve_3 = Curve(cluster_3)
point_4 = Point(point_3)
create_linear_element_karamba3d = LineElem(
    Line=curve_3,
    CrossSection=cross_section_karamba3d,
    LimitDistance_m=0.005,
    BucklingLengthY_m=-1,
    BucklingLengthZ_m=-1,
    BucklingLengthLT_m=-1,
    Bending=True,
    ToPolylineMaxAngle=0.03,
    ToPolylineTolerance=0.01,
    ToPolylineMaxEdgeLength=0.25,
    New=True,
    Remove=True,
    mode="LineToBeam")  # -> Element, Points, Info
support_karamba3d = Supp(PosInd=point_4, menu=[buttons(on, on, on, on, on, on)])
# Assemble Structural Model
number_slider_4 = Slider(0.3, range=0..10)
unit_z = UnitZ(Factor=1)
negative = Negative(Value=unit_z)
beam_loads_karamba3d = BeamLoads(
    BeamIdentifier=create_linear_element_karamba3d.Element,
    LoadCase="LC0",
    ForceVector=negative,
    TStart=0,
    TEnd=1,
    mode="Block",
    menu=[buttons(off, on, off)])
loads_karamba3d = Loads(Vector=Vector(0, 0, -1), LCase="LC0", mode="Gravity")
assemble_model_karamba3d = Assemble(
    Elem=create_linear_element_karamba3d.Element,
    Support=support_karamba3d,
    Load=flatten([loads_karamba3d, beam_loads_karamba3d]),
    LimitDistance_m=0.005)  # -> Model, Info, Mass_kg, CentreOfGravity, LoadCaseNames

analyse_karamba3d = Analyse(Model=assemble_model_karamba3d.Model)  # -> AnalysedModel, MaximumDisplacement_cm, ResultingForce_kN, ChangeOfElasticEnergy_kNm
model_view_karamba3d = ModelView(Model=analyse_karamba3d.AnalysedModel)  # -> Model, DeformedMesh, DeformedAxes, DeformedModel, MaximumDeformation
# Structural Evaluation Diagrams
reaction_view_karamba3d = ReactView(Model=model_view_karamba3d.Model)  # -> Model, LegendColours, LegendTags
beam_view_karamba3d = BeamView(Model=model_view_karamba3d.Model)  # -> Model, MeshesOfRenderedBeams, DeformedBeamAxes, LegendColours, LegendTags

disassemble_model_karamba3d = Disassemble(Model=beam_view_karamba3d.Model)  # -> Model, Point, Beam, Shell, Support, Load, Line, Mesh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
beam_forces_karamba3d = BForces(
    AnalysedModel=beam_view_karamba3d.Model,
    BeamsIdentifiers=disassemble_model_karamba3d.Beam,
    Ts=[Slider(0, range=0..100), Slider(0.5, range=0..1), Slider(1, range=0..1)])  # -> Model, NormalForce_kN, ShearForceVz_kN, ShearForceVy_kN, TorsionalMomentMt_kNm, BendingMomentMy_kNm, BendingMomentMz_kNm, LoadCaseIndex

# ----
# Bending
# Axial Force
# Shear Vz
# Shear Vy
partition_list = PartitionList(List=flatten(beam_forces_karamba3d.BendingMomentMy_kNm), Size=3)
partition_list_2 = PartitionList(List=flatten(beam_forces_karamba3d.NormalForce_kN), Size=3)
partition_list_3 = PartitionList(List=flatten(beam_forces_karamba3d.ShearForceVz_kN), Size=3)
# Structural Evaluation Data Lists
partition_list_4 = PartitionList(List=flatten(beam_forces_karamba3d.ShearForceVz_kN), Size=3)
absolute = Absolute(Value=partition_list)
sort_list = SortList(Keys=partition_list_2)  # -> Keys, ValuesValuesA
absolute_2 = Absolute(Value=partition_list_3)
absolute_3 = Absolute(Value=partition_list_4)
sort_list_2 = SortList(Keys=absolute)  # -> Keys, ValuesValuesA
sort_list_3 = SortList(Keys=absolute_2)  # -> Keys, ValuesValuesA
sort_list_4 = SortList(Keys=absolute_3)  # -> Keys, ValuesValuesA
list_item = ListItem(List=sort_list.Keys, Index=Slider(2, range=0..10), Wrap=True)  # -> flatten(Item)
list_item_2 = ListItem(List=sort_list.Keys, Index=Slider(0, range=0..10), Wrap=True)  # -> flatten(Item)
list_item_3 = ListItem(List=sort_list_2.Keys, Index=Slider(2, range=0..10), Wrap=True)  # -> flatten(Item)
list_item_4 = ListItem(List=sort_list_3.Keys, Index=Slider(0, range=0..10), Wrap=True)  # -> flatten(Item)
list_item_5 = ListItem(List=sort_list_3.Keys, Index=Slider(2, range=0..10), Wrap=True)  # -> flatten(Item)
list_item_6 = ListItem(List=sort_list_4.Keys, Index=Slider(0, range=0..10), Wrap=True)  # -> flatten(Item)
list_item_7 = ListItem(List=sort_list_4.Keys, Index=Slider(2, range=0..10), Wrap=True)  # -> flatten(Item)

length = Length(Curve=disassemble_model_karamba3d.Line)
list_length = ListLength(List=disassemble_model_karamba3d.Beam)
# Structural Member Solver
number_slider_5 = Slider(25, range=0..100)
file_path = FilePath("C:\Users\user\Desktop\Thesis\Model\ThesisModel_0705\strength_value.csv")
file_path_2 = FilePath("C:\Users\user\Desktop\Thesis\beamsDetails.csv")
c_script_4 = CSharpScript(
    numMembers=list_length,
    beamInfo=disassemble_model_karamba3d.Beam,
    beamLength=length,
    bending=list_item_3,
    axialForceS=list_item_2,
    axialForceE=list_item,
    shearVzS=list_item_4,
    shearVzE=list_item_5,
    shearVyS=list_item_6,
    shearVyE=list_item_7,
    materialsData=file_path,
    filePath=file_path_2,
    save=Button(),
    colNum=number_slider_5)  # -> out, memberLoc, memberSection, compositeNum, widths, heights, lengths, materials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; inputs numMembers: Int32, beamInfo: list of String, beamLength: list of Double, bending: list of Double, axialForceS: list of Double, axialForceE: list of Double, shearVzS: list of Double, shearVzE: list of Double, shearVyS: list of Double, shearVyE: list of Double, materialsData: String, filePath: String, save: Boolean, colNum: Int32
# ---------- c_script_4: C# ----------
// Grasshopper Script Instance
#region Usings
using System;
using System.Linq;
using System.Collections;
using System.Collections.Generic;
using System.Drawing;

using Rhino;
using Rhino.Geometry;

using Grasshopper;
using Grasshopper.Kernel;
using Grasshopper.Kernel.Data;
using Grasshopper.Kernel.Types;

using System.Text.RegularExpressions;
using System.IO;
#endregion

public class Script_Instance : GH_ScriptInstance
{
    #region Notes
    /* 
      Members:
        RhinoDoc RhinoDocument
        GH_Document GrasshopperDocument
        IGH_Component Component
        int Iteration

      Methods (Virtual & overridable):
        Print(string text)
        Print(string format, params object[] args)
        Reflect(object obj)
        Reflect(object obj, string method_name)
    */
    #endregion

    private void RunScript(
	int numMembers,
	List<string> beamInfo,
	List<double> beamLength,
	List<double> bending,
	List<double> axialForceS,
	List<double> axialForceE,
	List<double> shearVzS,
	List<double> shearVzE,
	List<double> shearVyS,
	List<double> shearVyE,
	string materialsData,
	string filePath,
	bool save,
	int colNum,
	ref object memberLoc,
	ref object memberSection,
	ref object compositeNum,
	ref object widths,
	ref object heights,
	ref object lengths,
	ref object materials,
	ref object maxRatios,
	ref object bendingRatios,
	ref object compressionRatios,
	ref object shearRatios,
	ref object diagramCenterPt,
	ref object diagramSection,
	ref object subSection,
	ref object textLine1,
	ref object textLine2,
	ref object textLine3,
	ref object textLine4,
	ref object textLine5)
    {
        // get raw data from Karamba
        List<string> pos = new List<string>();
        List<Point3d> start_pts = new List<Point3d>();
        List<Point3d> end_pts = new List<Point3d>();
        for(int i = 0; i< beamInfo.Count; i++){
            string[] data = beamInfo[i].Split(';');
            pos.Add(data[1]);
        }
        for(int i = 0; i<pos.Count; i++){
          int index1 = pos[i].IndexOf(')');
          int index2 = pos[i].LastIndexOf(':');
          string sp = pos[i].Substring(5,index1-5+1);
          string ep = pos[i].Substring(index2+1);
          Point3d sPt = getPtFromString(sp);
          Point3d ePt = getPtFromString(ep);
          start_pts.Add(sPt);
          end_pts.Add(ePt);
        }

        // assign to beam object and store in list
        List<Beam> beams = new List<Beam>();
        for(int i = 0; i<start_pts.Count; i++){
            int check_com = checkCompression(axialForceS[i],axialForceE[i]);
            double check_axialForce = checkAxialForce(axialForceS[i],axialForceE[i]);
            double check_shear = checkShear(shearVzS[i],shearVzE[i],shearVyS[i],shearVyE[i]);
            Beam b = new Beam(i,
                              start_pts[i],
                              end_pts[i],
                              beamLength[i],
                              bending[i]*10197.16,
                              check_com,
                              check_axialForce*101.9716,
                              check_shear*101.9716);
            beams.Add(b);
        }

        beams = beams.OrderByDescending(b=>b.bending).ToList();

        // setup timber size list
        List<string> size_List = new List<string>{
            "2x6","2x8","2x10","2x12",
            "4x6","4x8","4x10","4x12",
            "6x6","6x8","6x10","6x12"
        };
        // setup random with seed
        Random r = new Random(42);


        // get prediction result from csv file
        List<string> img_paths = new List<string>();
        List<double> MOR_list = new List<double>();
        List<double> MOE_list = new List<double>();
        List<double> shearing_list = new List<double>();
        List<double> compression_list = new List<double>();
        
        var matData = File.ReadAllLines(materialsData);
        for(int i = 1; i<matData.Length; i++){
            var item = matData[i].Split(',');
            img_paths.Add(item[0]);
            MOR_list.Add(double.Parse(item[1]));
            MOE_list.Add(double.Parse(item[2]));
            shearing_list.Add(double.Parse(item[3]));
            compression_list.Add(double.Parse(item[4]));
        }

        // assign to timber object and store in list
        List<Timber> timbers = new List<Timber>();
        for(int i = 0; i<img_paths.Count; i++){
            int rd = r.Next(4);
            Timber t = new Timber(i,img_paths[i],MOR_list[i],MOE_list[i],shearing_list[i],compression_list[i],size_List[rd]);
            double tWidth = getActualWidth(size_List[rd]);
            double tHeight = getActualHeight(size_List[rd]);
            t.tWidth = tWidth;
            t.tHeight = tHeight;
            // section module = (b * h * h)/6
            double s_value = (tWidth*tHeight*tHeight)/6;
            double s_area = tWidth*tHeight;
            t.maxBending = t.MOR*s_value;
            t.maxCompression = t.compression * s_area;
            t.maxShear = (t.shear * s_area * 2)/3;
            timbers.Add(t);
        }

        timbers = timbers.OrderByDescending(t=>t.maxBending).ToList();
        List<int> compositeNumList = new List<int>();
        List<double> widthList = new List<double>();
        List<double> heightList = new List<double>();
        List<double> lengthList = new List<double>();
        List<int> materialIDList = new List<int>();
        List<double> maxRatioList = new List<double>();
        List<double> ratioOfBendingList = new List<double>();
        List<double> ratioOfCompressionList = new List<double>();
        List<double> ratioOfShearList = new List<double>();

        // match timber to beam
        for(int i = 0; i<beams.Count; i++){
            if(beams[i].compression == 0){
                // for compression member, check all structural requirement
                // calculate the using number of timber
                int b = Convert.ToInt32(Math.Ceiling(beams[i].bending / timbers[i].maxBending));
                int c = Convert.ToInt32(Math.Ceiling(beams[i].axialForce / timbers[i].maxCompression));
                int s = Convert.ToInt32(Math.Ceiling(beams[i].shear / timbers[i].maxShear));
                int n = Math.Max(b,Math.Max(c,s));

                // Euler's buckling load Pcr = (pi^2 * E * I)/(KL)^2
                double require_i_value = beams[i].axialForce*Math.Pow(beams[i].bLength*100,2)/(Math.Pow(Math.PI,2)*timbers[i].MOE);
                double current_i_value = (timbers[i].tHeight* Math.Pow(timbers[i].tWidth*n,3))/12;
                if(require_i_value>current_i_value){
                    double require_width = Math.Pow((12* require_i_value)/timbers[i].tHeight,1.0/3);
                    int require_timberNum = Convert.ToInt32(Math.Ceiling(require_width/timbers[i].tWidth));
                    n = require_timberNum;
                }
                double pcr = (Math.Pow(Math.PI,2)*timbers[i].MOE*((timbers[i].tHeight*Math.Pow(timbers[i].tWidth*n,3))/12))/(Math.Pow(beams[i].bLength*100,2));
                
                beams[i].compositeNum = n;
                beams[i].materialID = timbers[i].timberID;
                beams[i].width = timbers[i].tWidth*n;
                beams[i].height = timbers[i].tHeight;
                beams[i].ratioOfBending = Math.Round((beams[i].bending / (timbers[i].maxBending*n)),2);
                beams[i].ratioOfCompression = Math.Max(Math.Round((beams[i].axialForce / (timbers[i].maxCompression*n)),2),
                                                                    beams[i].axialForce/ pcr);
                beams[i].ratioOfShear = Math.Round((beams[i].shear / (timbers[i].maxShear*n)),2);
                beams[i].maxRatio = Math.Max(beams[i].ratioOfBending, Math.Max(beams[i].ratioOfCompression, beams[i].ratioOfShear));
            }else if(beams[i].compression == 1){
                // for tension member, check all structural requirement
                int b = Convert.ToInt32(Math.Ceiling(beams[i].bending / timbers[i].maxBending));
                int s = Convert.ToInt32(Math.Ceiling(beams[i].shear / timbers[i].maxShear));
                int n = Math.Max(b,s);
                
                beams[i].compositeNum = n;
                beams[i].materialID = timbers[i].timberID;
                beams[i].width = timbers[i].tWidth*n;
                beams[i].height = timbers[i].tHeight;
                beams[i].ratioOfBending = Math.Round((beams[i].bending / (timbers[i].maxBending*n)),2);
                beams[i].ratioOfCompression = 0;
                beams[i].ratioOfShear = Math.Round((beams[i].shear / (timbers[i].maxShear*n)),2);
                beams[i].maxRatio = Math.Max(beams[i].ratioOfBending, Math.Max(beams[i].ratioOfCompression, beams[i].ratioOfShear));
            }
            
        }

        beams = beams.OrderBy(b=>b.beamID).ToList();
        timbers = timbers.OrderBy(t=>t.timberID).ToList();

        foreach (var beam in beams)
        {
            compositeNumList.Add(beam.compositeNum);
            widthList.Add(beam.width);
            heightList.Add(beam.height);
            lengthList.Add(beam.bLength*100);
            materialIDList.Add(beam.materialID);
            maxRatioList.Add(beam.maxRatio);
            ratioOfBendingList.Add(beam.ratioOfBending);
            ratioOfCompressionList.Add(beam.ratioOfCompression);
            ratioOfShearList.Add(beam.ratioOfShear);
        }

        // visualization
        List<Line> lns = new List<Line>();
        List<Rectangle3d> sections = new List<Rectangle3d>();

        foreach (var beam in beams)
        {
            Line ln = new Line(beam.startPt,beam.endPt);
            double sZ = beam.startPt.Z;
            double eZ = beam.endPt.Z;
            lns.Add(ln);
            if(sZ == eZ){
                Rectangle3d rect = new Rectangle3d(Plane.WorldXY,
                                               new Interval(((beam.height/200)*-1),((beam.height/200)*1)),
                                               new Interval(((beam.width/200)*-1),((beam.width/200)*1)));
                sections.Add(rect);
            }else{
                Rectangle3d rect = new Rectangle3d(Plane.WorldXY,
                                               new Interval(((beam.width/200)*-1),((beam.width/200)*1)),
                                               new Interval(((beam.height/200)*-1),((beam.height/200)*1)));
                sections.Add(rect);
            }
        }

        List<Point3d> centerPts = new List<Point3d>();
        List<Rectangle3d> rects = new List<Rectangle3d>();
        List<Rectangle3d> subRects = new List<Rectangle3d>();
        List<string> strLine1 = new List<string>();
        List<string> strLine2 = new List<string>();
        List<string> strLine3 = new List<string>();
        List<string> strLine4 = new List<string>();
        List<string> strLine5 = new List<string>();

        // draw the sections
        for(int i = 0;i < beams.Count;i++)
        {
        // create a plane
        Point3d o = new Point3d((i % colNum) * 5, (i / colNum) * 5 * -1, 0);
        //dCenterPts.Add(o);
        Plane pl = new Plane(o, Vector3d.ZAxis);
        // create a rectangle
        Rectangle3d rect = new Rectangle3d(pl,beams[i].width/100,beams[i].height/100);
        Point3d rectCenter = rect.Center;
        rect.Transform(Transform.Translation(new Vector3d(o.X - rectCenter.X, o.Y - rectCenter.Y,0)));
        
            for(int j = 0; j<beams[i].compositeNum;j++){
            Rectangle3d subRect = new Rectangle3d(new Plane(new Point3d(o.X+(timbers[beams[i].materialID].tWidth*j)/100,o.Y,o.Z),Vector3d.ZAxis),
                                                  timbers[beams[i].materialID].tWidth/100,timbers[beams[i].materialID].tHeight/100);
            subRect.Transform(Transform.Translation(new Vector3d(o.X - rectCenter.X, o.Y - rectCenter.Y,0)));
            subRects.Add(subRect);
            }
            
        rects.Add(rect);
        Point3d textCenter = new Point3d(o.X +0.1, o.Y+0.1, 0);
        centerPts.Add(textCenter);
        
   
        string line1 = "Member Index: " + beams[i].beamID.ToString();
        string line2 = "Number of Composite: " + beams[i].compositeNum.ToString();
        string line3 = "From: ( " + Math.Round(beams[i].startPt.X,2).ToString() + ", " + Math.Round(beams[i].startPt.Y,2).ToString() + ", "+ Math.Round(beams[i].startPt.Z,2).ToString() + ")" +
                       "  To: ( " + Math.Round(beams[i].endPt.X,2).ToString() + ", " + Math.Round(beams[i].endPt.Y,2).ToString() + ", "+ Math.Round(beams[i].endPt.Z,2).ToString() + ")";
        string line4 = "Width: " + Math.Round(beams[i].width,2).ToString() +" cm" + "   Height: " + Math.Round(beams[i].height,2).ToString() + " cm";
        string line5 = "Material Index: " + beams[i].materialID;
        strLine1.Add(line1);
        strLine2.Add(line2);
        strLine3.Add(line3);
        strLine4.Add(line4);
        strLine5.Add(line5);
        
        }

        // save csv file
        if(save==true){
            SaveCSV(filePath,beams,timbers);
        }

        
        memberLoc = lns;
        memberSection = sections;
        compositeNum = compositeNumList;
        widths = widthList;
        heights = heightList;
        lengths = lengthList;
        materials = materialIDList;
        maxRatios = maxRatioList;
        bendingRatios = ratioOfBendingList;
        compressionRatios = ratioOfCompressionList;
        shearRatios = ratioOfShearList;
        diagramCenterPt = centerPts;
        diagramSection = rects;
        subSection = subRects;
        textLine1 = strLine1;
        textLine2 = strLine2;
        textLine3 = strLine3;
        textLine4 = strLine4;
        textLine5 = strLine5;
    }

    public Point3d getPtFromString(string a){
        // Remove the parentheses
        string cleanedString = a.Trim('(',')');
        // Split the string by commas
        string[] parts = cleanedString.Split(',');
        // Parse the x, y, z coordinates
        double x = double.Parse(parts[0].Trim());
        double y = double.Parse(parts[1].Trim());
        double z = double.Parse(parts[2].Trim());
        // Create a new Point3d object and add it to the list
        Point3d pt = new Point3d(x,y,z);
        return pt;
    }

    public int checkCompression(double a, double b){
        int check=-1;
        if (a<0 && b <0){
            check=0;
        }else if (a>=0 && b>=0){
            check=1;
        }else if (a*b<=0){
            if(Math.Abs(a)>Math.Abs(b)){
                if(a<0){
                    check=0;
                }else{
                    check=1;
                }
            }else{
                if(b<0){
                    check=0;
                }else{
                    check=1;
                }
            }
        }
        return check;
    }

    public double checkAxialForce(double a, double b){
        double force = 0;
        if(Math.Abs(a)>Math.Abs(b)){
            force = Math.Abs(a);
        }else{
            force = Math.Abs(b);
        }
        return force;
    }

    public double checkShear(double a, double b, double c, double d){
        double shear = 0;
        double _a = Math.Abs(a);
        double _b = Math.Abs(b);
        double _c = Math.Abs(c);
        double _d = Math.Abs(d);
        shear = Math.Max(_a, Math.Max(_b, Math.Max(_c,_d)));

        return shear;
    }

    public double getActualWidth(string a){
        double width = 0;
        if(a=="2x6" || a=="2x8" || a=="2x10" || a=="2x12"){
            width=3.8;
        }else if(a=="4x6" || a=="4x8" || a=="4x10" || a=="4x12"){
            width=8.9;
        }else if(a=="6x6" || a=="6x8" || a=="6x10" || a=="6x12"){
            width=14;
        }
        return width;
    }

    public double getActualHeight(string a){
        double height = 0;
        if(a=="2x6" || a=="4x6" || a=="6x6"){
            height=14;
        }else if(a=="2x8" || a=="4x8" || a=="6x8"){
            height=18.4;
        }else if(a=="2x10" || a=="4x10" || a=="6x10"){
            height=23.5;
        }else if(a=="2x12" || a=="4x12" || a=="6x12"){
            height=28.6;
        }
        return height;
    }
    public void SaveCSV(string savePath, List<Beam> beams, List<Timber> timbers){
        string[] outputBeams = new string[beams.Count+1];
        outputBeams[0] = "Member Index" + ","
                        +"startPt.X" + ","
                        +"startPt.Y" + ","
                        +"startPt.Z" + ","
                        +"endPt.X" + ","
                        +"endPt.Y" + ","
                        +"endPt.Z" + ","
                        +"Number of Composite" + ","
                        +"Material ID" + ","
                        +"Beam Width" + ","
                        +"Beam Height" + ","
                        +"Timber Image"
                        ;
            for (int i = 0; i < beams.Count; i++){
                outputBeams[i+1] = i.ToString() + ","
                + Math.Round(beams[i].startPt.X,2).ToString() + "," 
                + Math.Round(beams[i].startPt.Y,2).ToString() + ","
                + Math.Round(beams[i].startPt.Z,2).ToString() + ","
                + Math.Round(beams[i].endPt.X,2).ToString() + "," 
                + Math.Round(beams[i].endPt.Y,2).ToString() + ","
                + Math.Round(beams[i].endPt.Z,2).ToString() + ","
                + beams[i].compositeNum.ToString() + ","
                + beams[i].materialID.ToString() + ","
                + Math.Round(beams[i].width,2).ToString() + ","
                + Math.Round(beams[i].height,2).ToString() + ","
                + timbers[beams[i].materialID].img_path
                ;
            }
        File.WriteAllLines(savePath, outputBeams);
    }
}


public class Beam{
    public int beamID;
    public Point3d startPt;
    public Point3d endPt;
    public double bLength;
    public double bending;
    public int compression; //0 for compression, 1 for tension
    public double axialForce;
    public double shear;
    public int materialID;
    public int compositeNum;
    public double width;
    public double height;
    public double ratioOfBending;
    public double ratioOfCompression;
    public double ratioOfShear;
    public double maxRatio;

    public Beam(int beamID,
                Point3d startPt, 
                Point3d endPt,
                double bLength,
                double bending,
                int compression,
                double axialForce,
                double shear){
        this.beamID = beamID;
        this.startPt = startPt;
        this.endPt = endPt;
        this.bLength = bLength;
        this.bending = bending;
        this.compression = compression;
        this.axialForce = axialForce;
        this.shear = shear;
    }
}

public class Timber{
    public int timberID;
    public string img_path;
    public double MOR;
    public double MOE;
    public double shear;
    public double compression;
    public string nominalSize;
    public double tWidth;
    public double tHeight;
    public double maxBending;
    public double maxCompression;
    public double maxShear;

    public Timber(int timberID,
                  string img_path,
                  double MOR,
                  double MOE,
                  double shear,
                  double compression,
                  string nominalSize){
        this.timberID = timberID;
        this.img_path = img_path;
        this.MOR = MOR;
        this.MOE = MOE;
        this.shear = shear;
        this.compression = compression;
        this.nominalSize = nominalSize;
    }
}
# ---------- end c_script_4 ----------
number_slider_6 = Slider(0, range=0..387)
point_5 = Point(c_script_4.diagramCenterPt)
curve_4 = Curve(c_script_4.subSection)
curve_5 = Curve(c_script_4.diagramSection)
# Real-time Data Display
curve_6 = Curve(c_script_4.memberLoc)
curve_7 = Curve(c_script_4.memberSection)
c_script_5 = CSharpScript(
    index=number_slider_6,
    comNum=c_script_4.compositeNum,
    width=c_script_4.widths,
    height=c_script_4.heights,
    length=c_script_4.lengths,
    material=c_script_4.materials,
    maxRatio=c_script_4.maxRatios,
    ratioBending=c_script_4.bendingRatios,
    ratioCompression=c_script_4.compressionRatios,
    ratioShear=c_script_4.shearRatios)  # -> out, a; inputs index: Int32, comNum: list of Int32, width: list of Double, height: list of Double, length: list of Double, material: list of Int32, maxRatio: list of Double, ratioBending: list of Double, ratioCompression: list of Double, ratioShear: list of Double
# ---------- c_script_5: C# ----------
// Grasshopper Script Instance
#region Usings
using System;
using System.Linq;
using System.Collections;
using System.Collections.Generic;
using System.Drawing;

using Rhino;
using Rhino.Geometry;

using Grasshopper;
using Grasshopper.Kernel;
using Grasshopper.Kernel.Data;
using Grasshopper.Kernel.Types;
#endregion

using Rhino.UI;
using Rhino.Geometry.Intersect;
using System.Windows.Forms;
using System.Windows.Input;
using System.Drawing;

public class Script_Instance : GH_ScriptInstance
{
    #region Notes
    /* 
      Members:
        RhinoDoc RhinoDocument
        GH_Document GrasshopperDocument
        IGH_Component Component
        int Iteration

      Methods (Virtual & overridable):
        Print(string text)
        Print(string format, params object[] args)
        Reflect(object obj)
        Reflect(object obj, string method_name)
    */
    #endregion

    private void RunScript(
	int index,
	List<int> comNum,
	List<double> width,
	List<double> height,
	List<double> length,
	List<int> material,
	List<double> maxRatio,
	List<double> ratioBending,
	List<double> ratioCompression,
	List<double> ratioShear,
	ref object a)
    {
        txtOnScreen1 = index.ToString();
        if (index>comNum.Count){
            string noValue = "No Value";
            txtOnScreen2 = noValue;
            txtOnScreen3 = noValue;
            txtOnScreen4 = noValue;
            txtOnScreen5 = noValue;
            txtOnScreen6 = noValue;
            txtOnScreen7 = noValue;
            txtOnScreen8 = noValue;
            txtOnScreen9 = noValue;
            txtOnScreen10 = noValue;

        }else{
            txtOnScreen2 = comNum[index].ToString();
            txtOnScreen3 = Math.Round(width[index],2).ToString()+ " cm";
            txtOnScreen4 = Math.Round(height[index],2).ToString()+ " cm";
            txtOnScreen5 = Math.Round(length[index],2).ToString()+ " cm";
            txtOnScreen6 = material[index].ToString();
            txtOnScreen7 = Math.Round(maxRatio[index],2).ToString();
            txtOnScreen8 = Math.Round(ratioBending[index],2).ToString();
            txtOnScreen9 = Math.Round(ratioCompression[index],2).ToString();
            txtOnScreen10 = Math.Round(ratioShear[index],2).ToString();
        }
    }
        Color color = Color.FromArgb(255, 50, 50, 50);
        string viewportName = "Perspective";
        string txtOnScreen1 = null;
        string txtOnScreen2 = null;
        string txtOnScreen3 = null;
        string txtOnScreen4 = null;
        string txtOnScreen5 = null;
        string txtOnScreen6 = null;
        string txtOnScreen7 = null;
        string txtOnScreen8 = null;
        string txtOnScreen9 = null;
        string txtOnScreen10 = null;


  //Draw all wires and points in this method.
  public override void DrawViewportWires(IGH_PreviewArgs args)
  {

    Point3d viewPt = RhinoDocument.Views.ActiveView.ActiveViewport.CameraLocation;
    Rhino.Display.RhinoView view = RhinoDocument.Views.Find(viewportName, false);

    if(view == null){
      view = RhinoDocument.Views.ActiveView; // assign active view
    }

    //Title position on screen
    Point2d ptScreen_0 = new Point2d(25.0, 30.0);
    args.Display.Draw2dText("Member Index", color, ptScreen_0, false, 15);
    //Units count position on screen
    Point2d ptScreen_1 = new Point2d(25.0, 50.0);
    args.Display.Draw2dText(txtOnScreen1, color, ptScreen_1, false, 35);
    //Title position on screen
    Point2d ptScreen_2 = new Point2d(25.0, 80.0);
    args.Display.Draw2dText("Number of Composite", color, ptScreen_2, false, 15);
    //Units count position on screen
    Point2d ptScreen_3 = new Point2d(25.0, 100.0);
    args.Display.Draw2dText(txtOnScreen2, color, ptScreen_3, false, 35);
    //Title position on screen
    Point2d ptScreen_4 = new Point2d(25.0, 130.0);
    args.Display.Draw2dText("Member Width", color, ptScreen_4, false, 15);
    //Units count position on screen
    Point2d ptScreen_5 = new Point2d(25.0, 150.0);
    args.Display.Draw2dText(txtOnScreen3, color, ptScreen_5, false, 35);
    //Title position on screen
    Point2d ptScreen_6 = new Point2d(25.0, 180.0);
    args.Display.Draw2dText("Member Height", color, ptScreen_6, false, 15);
    //Units count position on screen
    Point2d ptScreen_7 = new Point2d(25.0, 200.0);
    args.Display.Draw2dText(txtOnScreen4, color, ptScreen_7, false, 35);
    //Title position on screen
    Point2d ptScreen_8 = new Point2d(25.0, 230.0);
    args.Display.Draw2dText("Member Length", color, ptScreen_8, false, 15);
    //Units count position on screen
    Point2d ptScreen_9 = new Point2d(25.0, 250.0);
    args.Display.Draw2dText(txtOnScreen5, color, ptScreen_9, false, 35);
    //Title position on screen
    Point2d ptScreen_10 = new Point2d(25.0, 280.0);
    args.Display.Draw2dText("Material Index", color, ptScreen_10, false, 15);
    //Units count position on screen
    Point2d ptScreen_11 = new Point2d(25.0, 300.0);
    args.Display.Draw2dText(txtOnScreen6, color, ptScreen_11, false, 35);
    //Title position on screen
    Point2d ptScreen_12 = new Point2d(25.0, 330.0);
    args.Display.Draw2dText("Maximun Ratio", color, ptScreen_12, false, 15);
    //Units count position on screen
    Point2d ptScreen_13 = new Point2d(25.0, 350.0);
    args.Display.Draw2dText(txtOnScreen7, color, ptScreen_13, false, 35);
    //Title position on screen
    Point2d ptScreen_14 = new Point2d(25.0, 380.0);
    args.Display.Draw2dText("Ratio of Bending", color, ptScreen_14, false, 15);
    //Units count position on screen
    Point2d ptScreen_15 = new Point2d(25.0, 400.0);
    args.Display.Draw2dText(txtOnScreen8, color, ptScreen_15, false, 35);
    //Title position on screen
    Point2d ptScreen_16 = new Point2d(25.0, 430.0);
    args.Display.Draw2dText("Ratio of Compression", color, ptScreen_16, false, 15);
    //Units count position on screen
    Point2d ptScreen_17 = new Point2d(25.0, 450.0);
    args.Display.Draw2dText(txtOnScreen9, color, ptScreen_17, false, 35);
    //Title position on screen
    Point2d ptScreen_18 = new Point2d(25.0, 480.0);
    args.Display.Draw2dText("Ratio of Shear", color, ptScreen_18, false, 15);
    //Units count position on screen
    Point2d ptScreen_19 = new Point2d(25.0, 500.0);
    args.Display.Draw2dText(txtOnScreen10, color, ptScreen_19, false, 35);

  }

}
# ---------- end c_script_5 ----------
panel = Panel(c_script_4.lengths)
number_slider_7 = Slider(0.2, range=0..10)
colour_swatch_2 = ColourSwatch(SwatchColor=RGB(50, 50, 50))

number_slider_8 = Slider(500, range=0..10000)
vector_xyz = VectorXYZ(XComponent=number_slider_8, YComponent=number_slider_8, ZComponent=0)  # -> Vector, Length
move = Move(Geometry=point_5, Motion=vector_xyz.Vector)  # -> Geometry, Transform
move_2 = Move(Geometry=curve_5, Motion=vector_xyz.Vector)  # -> Geometry, Transform
unit_y = UnitY(Factor=Slider(0.1, range=0..0.1))
number_slider_9 = Slider(0.03, range=0..0.1)
move_3 = Move(Geometry=move.Geometry, Motion=expr("x*-1", unit_y))  # -> Geometry, Transform
move_4 = Move(Geometry=move.Geometry, Motion=expr("x*-2", unit_y))  # -> Geometry, Transform
move_5 = Move(Geometry=move.Geometry, Motion=expr("x*-3.5", unit_y))  # -> Geometry, Transform
# 2D Detailed Section Drawings
move_6 = Move(Geometry=move.Geometry, Motion=expr("x*-8", unit_y))  # -> Geometry, Transform
text_tag_3d = TextTag3D(Location=move.Geometry, Text=c_script_4.textLine1, Size=number_slider_9, Colour=colour_swatch_2, Justification=4)
text_tag_3d_2 = TextTag3D(Location=move_3.Geometry, Text=c_script_4.textLine2, Size=number_slider_9, Justification=4)
text_tag_3d_3 = TextTag3D(Location=move_4.Geometry, Text=c_script_4.textLine3, Size=number_slider_9, Justification=4)
text_tag_3d_4 = TextTag3D(Location=move_5.Geometry, Text=c_script_4.textLine4, Size=number_slider_9, Colour=colour_swatch_2, Justification=4)
text_tag_3d_5 = TextTag3D(Location=move_6.Geometry, Text=c_script_4.textLine5, Size=number_slider_9, Colour=colour_swatch_2, Justification=4)

perp_frames = PerpFrames(Curve=curve_6, Count=Slider(1, range=0..1), Align=True)  # -> Frames, Parameters
list_item_8 = ListItem(List=perp_frames.Frames, Index=Slider(0, range=0..100), Wrap=True)
orient = Orient(Geometry=curve_7, Source=PlaneXY(0, 0, 0), Target=flatten(list_item_8))  # -> Geometry, Transform
sweep1 = Sweep1(Rail=graft(curve_6), Sections=graft(orient.Geometry), Miter=1)  # -> flatten(Brep)
# Represented Model
number_slider_10 = Slider(80, range=0..100)
unit_x = UnitX(Factor=number_slider_10)

cap_holes = CapHoles(Brep=sweep1)

move_7 = Move(Geometry=cap_holes, Motion=unit_x)  # -> Geometry, Transform
list_item_9 = ListItem(List=move_7.Geometry, Index=number_slider_6, Wrap=False)
custom_preview_2 = CustomPreview(Geometry=move_7.Geometry, Material=ColourSwatch(SwatchColor=RGBA(198, 240, 255, 134)))
custom_preview_3 = CustomPreview(Geometry=list_item_9, Material=ColourSwatch(SwatchColor=RGB(250, 97, 255)))

# ==== cluster Cluster
geometry = ClusterInput()
area = Area(Geometry=geometry)  # -> Area, Centroid
geometry_2 = ClusterInput()
scale = Scale(Geometry=geometry_2, Center=area.Centroid, Factor=Slider(0.9, range=0..1))  # -> Geometry, Transform
deconstruct_brep = DeconstructBrep(Brep=scale.Geometry)  # -> Faces, Edges, Vertices
vertices = ClusterOutput(deconstruct_brep.Vertices)

# ==== cluster Cluster_2
curve = ClusterInput()
explode = Explode(Curve=curve, Recursive=True)  # -> flatten(Segments), Vertices
join_curves = JoinCurves(Curves=explode.Segments, Preserve=False)
cull_index = CullIndex(List=join_curves, Indices=Slider(0, range=0..100), Wrap=True)
explode_2 = Explode(Curve=cull_index, Recursive=True)  # -> Segments, Vertices
curve_2 = Curve(flatten(explode_2.Segments))
length = Length(Curve=curve_2)
sort_list = SortList(Keys=length, ValuesValuesA=curve_2)  # -> Keys, ValuesValuesA
dispatch = Dispatch(List=sort_list.ValuesValuesA, DispatchPattern=[True, False])  # -> ListA, ListB
list_a = ClusterOutput(dispatch.ListA)

# ==== cluster Cluster_3
curves = ClusterInput()
sort_duplicate_curves = SortDuplicateCurves(Curves=curves)  # -> UniqueCurves, Indices
curve_middle = CurveMiddle(Curve=sort_duplicate_curves.UniqueCurves)
sort_duplicate_values = SortDuplicateValues(ValueList=curve_middle)  # -> UniqueValues, Indices
list_item = ListItem(List=sort_duplicate_values.Indices, Index=0, Wrap=True)  # -> flatten(Item)
list_item_2 = ListItem(List=sort_duplicate_curves.UniqueCurves, Index=list_item, Wrap=True)
i = ClusterOutput(list_item_2)
